# Dynamo graph CurtainWallRandom.dyn (Dynamo 2.10.1.3976)

select_model_element = DSModelElementSelection()  # 1 picked in the model
vAdj = DoubleSlider(1.5, range=0..5 step 0.1)
vmax_space = DoubleSlider(13.9, range=0..20 step 0.1)
create_wall_and_curtain_grids = Python(IN[0]=select_model_element, IN[1]=vAdj, IN[2]=vmax_space)  # IronPython2
# ---------- create_wall_and_curtain_grids.python (109 lines) ----------
# Copyright (c)2017 By Travis M Williams
import clr
clr.AddReference('ProtoGeometry')
import Autodesk.DesignScript.Geometry as dsGeo

import sys
sys.path.append('C:\Program Files (x86)\IronPython 2.7\Lib')
import random

clr.AddReference('RevitNodes')
import Revit
clr.ImportExtensions(Revit.Elements)
clr.ImportExtensions(Revit.GeometryConversion)

clr.AddReference('RevitAPI')
from Autodesk.Revit.DB import *

clr.AddReference('RevitServices')
from RevitServices.Persistence import DocumentManager
from RevitServices.Transactions import TransactionManager

import math

def vStartPoints(uCurve,vSpace,vRange):
	pts = []
	curLen = uCurve.Length
	numV = int(math.ceil(curLen/vSpace))
	segLen = 0
	for i in range(0,numV-1):
		try:
			vAdj = random.uniform(-vRange,vRange)
		except:
			vAdj= 0
		segLen = segLen+(curLen/numV)+vAdj
		
		pt = uCurve.PointAtSegmentLength(segLen)
		pts.append(pt)
	return pts
	
wall = UnwrapElement(IN[0])
vAdjMax= IN[1]
vMax = IN[2]

# Variables
doc = DocumentManager.Instance.CurrentDBDocument
units=1
unitSys = doc.DisplayUnitSystem
if str(unitSys)=="METRIC":
	units = 304.8

#get unit types for multiplier
lvlColl = FilteredElementCollector(doc).OfClass(Level).WhereElementIsNotElementType().ToElements()
lvlElevs = [e.ProjectElevation for e in lvlColl]

locCur = wall.Location.Curve
		
p0 = locCur.GetEndPoint(0)
uCur = locCur.ToProtoType()#base curve run horizontal dir

TransactionManager.Instance.EnsureInTransaction(doc)

#clear all existing grids
doc.Delete(wall.CurtainGrid.GetUGridLineIds())
doc.Delete(wall.CurtainGrid.GetVGridLineIds())

#create u grids to split wall into sections first
uGridCurs = [locCur]#start list with base curve

#create u grid by levels
for el in lvlElevs[1:-1]:
	pt = XYZ(p0.X,p0.Y,el)
	uGrid = wall.CurtainGrid.AddGridLine(True, pt, False) #horizontal grids
	uGridCurs.append(uGrid.AllSegmentCurves[0])#this curve is for calculate vertical curve start points

vPtSet = []
for cur in uGridCurs:	
	vPts = vStartPoints(cur.ToProtoType(),vMax,vAdjMax)
	vPtSet.append(vPts)

errors = []

#add v grids to each wall sections
for set in vPtSet:
	for pt in set:
		try:
			vGrid = wall.CurtainGrid.AddGridLine(False, pt.ToXyz(), True)
		except Exception as er:
			errors.append(er)
			
doc.Regenerate()	
#collect panel types
panelTypeColl = FilteredElementCollector(doc).OfClass(PanelType).WhereElementIsElementType()
sysPanelTypes = [e for e in panelTypeColl if e.LookupParameter("Type Name").AsString().StartsWith("Solid")]
#make sure have matched name system panel type created

#replace panels	
allPanels = []
for id in wall.CurtainGrid.GetPanelIds():
	#random pick a panel to change
	indx = random.randint(0,len(sysPanelTypes)-1)
	panel = sysPanelTypes[indx]
	e = doc.GetElement(id)#panel
	e.ChangeTypeId(panel.Id)#set all panel to defult
	allPanels.append(e)
		
	
TransactionManager.Instance.TransactionTaskDone()	

OUT  = allPanels,errors  #vPts,uGrids,vPtSet
# ----------------------------------------
